# Grasshopper definition CoralStructure.gh (Grasshopper 1.0.7)
# plug-ins: Bifocals, Shortest Walk in Gh

number_slider = Slider(36, range=0..100)
sphere = Sphere(Base=PlaneXY(0, 0, 0), Radius=number_slider)
addition = Addition(B=number_slider)
construct_point = ConstructPoint(XCoordinate=0, YCoordinate=0, ZCoordinate=addition)
construct_point_2 = ConstructPoint(XCoordinate=0, YCoordinate=0, ZCoordinate=0)
# Bounding Space
number_slider_2 = Slider(0, range=0..100)
# Step 1
negative = Negative(Value=number_slider_2)
line_sdl = LineSDL(Start=construct_point_2, Direction=Vector(0, 0, 1), Length=negative)
line_sdl_2 = LineSDL(Start=construct_point, Direction=Vector(0, 0, 1), Length=Slider(25, range=0..100))
spatial_deform = SpatialDeform(Geometry=sphere, Syntax=[construct_point_2, construct_point], Forces=[line_sdl, line_sdl_2])
bounding_box = BoundingBox(Content=spatial_deform, Plane=PlaneXY(0, 0, 0))  # -> Box, Box_2

number_slider_3 = Slider(60, range=0..100)
construct_domain = ConstructDomain(DomainStart=Slider(0.4, range=0..1), DomainEnd=1)
# Random Points
random = Random(Range=Domain(0, 1), Number=number_slider_3, Seed=2)
random_2 = Random(Range=construct_domain, Number=number_slider_3, Seed=2)
construct_point_3 = ConstructPoint(XCoordinate=random, YCoordinate=random_2, ZCoordinate=0)
evaluate_surface = EvaluateSurface(Surface=reparameterize(spatial_deform), Point=construct_point_3)  # -> Point, Normal, UDirection, VDirection, Frame
point = Point(evaluate_surface.Point)

# ----
# Step 2a
# Negative Space
negative_2 = Negative(Value=number_slider)
# Step 2b
addition_2 = Addition(A=Slider(1, range=0..20), B=number_slider_2)
subtraction = Subtraction(A=negative_2, B=addition_2)
construct_point_4 = ConstructPoint(XCoordinate=0, YCoordinate=0, ZCoordinate=subtraction)

populate_3d = Populate3D(Region=bounding_box.Box, Count=Slider(605, range=0..1000), Seed=1)
# Branching
point_2 = Point(flatten([point, populate_3d, construct_point_4]))
proximity_3d = Proximity3D(Points=flatten(point_2), Group=5)  # -> flatten(Links), Topology
# Step 3
line = Line(StartPoint=construct_point_4, EndPoint=point)
shortest_walk = ShortestWalk(Curves=proximity_3d.Links, WantedPath=line)  # -> ShortestWalk, Succession, Direction, Length

# ---- group: Mesh
discontinuity = Discontinuity(Curve=reparameterize(shortest_walk.ShortestWalk), Level=1)  # -> Points, simplify(Parameters)
list_length = ListLength(List=discontinuity.Points)
construct_domain_2 = ConstructDomain(DomainStart=Slider(1.3, range=0.1..1.5), DomainEnd=Slider(0.2, range=0..1))
# Mesh Creating
knot_vector = KnotVector(Count=list_length, Degree=3, Periodic=False)
remap_numbers = RemapNumbers(Value=discontinuity.Parameters, Source=Domain(0, 1), Target=construct_domain_2)  # -> Mapped, Clipped
# Step 4
nurbs_curve_pwk = NurbsCurvePWK(Points=discontinuity.Points, Knots=knot_vector)  # -> Curve, Length, Domain
pipe_variable = PipeVariable(
    Curve=reparameterize(graft(nurbs_curve_pwk.Curve)),
    Parameters=discontinuity.Parameters,
    Radii=remap_numbers.Mapped,
    Caps=0)  # -> simplify(Pipe)
mesh = Mesh(pipe_variable)

# ----
custom_preview = CustomPreview(Geometry=mesh, Material=ColourSwatch(SwatchColor=RGB(12, 163, 131)))
